# Grasshopper definition 210401_area_to_volume.gh (Grasshopper 1.0.7)
# plug-ins: LunchBox

file_path = FilePath("E:\Code\arearatio.csv")
read_file = ReadFile(File=file_path, PerLineParse=True)
read_csv = ReadCSV(CSVString=read_file, Delimiter=",")  # -> Headers, Values
flip_matrix = FlipMatrix(Data=read_csv.Values)
panel = Panel(read_csv.Values)
explode_tree = ExplodeTree(Data=panel)  # -> Branch0, Branch1, Branch2, Branch3, Branch4
functions = Panel(explode_tree.Branch0)
area_of_each_space = Panel(explode_tree.Branch1)
length_width_ratio = Panel(explode_tree.Branch2)
number_of_spaces = Panel(explode_tree.Branch3)
total_area = Panel(explode_tree.Branch4)
number_slider = Slider(5, range=0..10)
ghpython_script = GhPythonScript(InputFunction=functions, InputArea=area_of_each_space, InputRatio=length_width_ratio, graphWidth=number_slider)  # -> out, boundary, tagtransformlist, functionList; inputs InputFunction: list, InputArea: list, InputRatio: list
# ---------- ghpython_script: Python ----------
__author__ = "mukul"
__version__ = "2020.12.21"

import rhinoscriptsyntax as rs
import math
from System.Drawing import *
from Rhino import *
from Rhino.DocObjects import *
from Rhino.Geometry import *
from Rhino.Input import *
from Rhino.Commands import *
from Rhino.UI.Dialogs import ShowColorDialog
from scriptcontext import doc
import ghpythonlib.treehelpers as th

boundary=[]
tagtransformlist=[]
functionList =[]
plane = rs.WorldXYPlane()
width = graphWidth
totalarea= sum(InputArea)
Offset=0

for i in range(0,len(InputFunction)):
 percentage = (InputArea[i]/totalarea)*100
 function = InputFunction[i] + "   " + str(InputArea[i]) + "sqm"+"   " + str(int(percentage)) +"%"
 functionList.append(function)
 area = InputArea[i]
 length = area/width
 a = rs.AddRectangle(plane,width,length)
 tagtransform = rs.AddPoint(width/2,Offset+ length/2,0)
 translation = rs.VectorCreate(rs.AddPoint(0,Offset,0),rs.AddPoint(0,0,0))
 rs.MoveObject(a,translation)
 tagtransformlist.append(tagtransform)
 boundary.append(a)
 Offset = Offset +length
# ---------- end ghpython_script ----------
panel_2 = Panel(ghpython_script.tagtransformlist)
ghpython_script_2 = GhPythonScript(x=functions)  # -> out, a; inputs x: tree
# ---------- ghpython_script_2: Python ----------
__author__ = "mukul"
__version__ = "2021.04.01"

import rhinoscriptsyntax as rs

a = []

for i in range(x.BranchCount):
    branchList = x.Branch(i)
    branchPath = x.Path(i)
    
    for j in range(branchList.Count):
        s = str(branchPath) + "[" + str(j) + "] "
        s += type(branchList[j]).__name__ + ": "
        s += str(branchList[j])
        
        a.append(s)
# ---------- end ghpython_script_2 ----------
ghpython_script_3 = GhPythonScript(InputFunction=functions, InputArea=area_of_each_space, InputRatio=length_width_ratio)  # -> out, boundary
# ---------- ghpython_script_3: Python ----------
__author__ = "mukul"
__version__ = "2020.12.21"

import rhinoscriptsyntax as rs
import math
from System.Drawing import *
from Rhino import *
from Rhino.DocObjects import *
from Rhino.Geometry import *
from Rhino.Input import *
from Rhino.Commands import *
from Rhino.UI.Dialogs import ShowColorDialog
from scriptcontext import doc

function = InputFunction 
area = float(InputArea)
ratio = float(InputRatio)

width = math.sqrt(area)*ratio
length = area/width

plane = rs.WorldXYPlane()
boundary = rs.AddRectangle(plane,width,length)
# ---------- end ghpython_script_3 ----------
ghpython_script_4 = GhPythonScript(InputFunction=functions, InputArea=area_of_each_space, InputRatio=length_width_ratio, graphWidth=number_slider)  # -> out, boundary
# ---------- ghpython_script_4: Python ----------
__author__ = "mukul"
__version__ = "2020.12.21"

import rhinoscriptsyntax as rs
import math
from System.Drawing import *
from Rhino import *
from Rhino.DocObjects import *
from Rhino.Geometry import *
from Rhino.Input import *
from Rhino.Commands import *
from Rhino.UI.Dialogs import ShowColorDialog
from scriptcontext import doc
import ghpythonlib.treehelpers as th


function = InputFunction 
area = float(InputArea)


width = graphWidth
length = area/width

plane = rs.WorldXYPlane()
boundary = rs.AddRectangle(plane,width,length)
# ---------- end ghpython_script_4 ----------
panel_3 = Panel(ghpython_script_2.a)

geometry = Geometry(ghpython_script.boundary)
text_tag = TextTag(Location=ghpython_script.tagtransformlist, Text=ghpython_script.functionList, Colour=RGB(0, 0, 0))
