# Grasshopper definition Aggregator.gh (Grasshopper 1.0.7)
# plug-ins: Pufferfish, Anemone, LunchBox

number_slider = Slider(10, range=0..50)
geometry = Geometry(<curve referenced from the Rhino model>)
ghpython_script = GhPythonScript(x=number_slider, y=number_slider, z=number_slider, u=Slider(500, range=0..500))  # -> out, a; inputs x: Int32, y: Int32, z: Int32
# ---------- ghpython_script: Python ----------
__author__ = "mukul"
__version__ = "2021.04.05"


import rhinoscriptsyntax as rs
import math
from System.Drawing import *
from Rhino import *
from Rhino.DocObjects import *
from Rhino.Geometry import *
from Rhino.Input import *
from Rhino.Commands import *
from Rhino.UI.Dialogs import ShowColorDialog
from scriptcontext import doc
import ghpythonlib.treehelpers as th


a=[]

for i in range(x):
    for j in range(y):
        for k in range(z):
            point = rs.AddPoint(i*u,j*u,k*u)
            a.append(point)
# ---------- end ghpython_script ----------
point = Point(ghpython_script.a)
pull_point = PullPoint(Point=point, Geometry=geometry, ClosestOnly=True)  # -> ClosestPoint, Distance
smaller_than = SmallerThan(FirstNumber=pull_point.Distance, SecondNumber=Slider(691, range=0..1000))  # -> SmallerThan, OrEqualTo
cull_duplicates = CullDuplicates(Points=point, Tolerance=0.1, CullMode=3)  # -> flatten(Points), Indices, Valence
cull_pattern = CullPattern(List=point, CullPattern=smaller_than.SmallerThan)
closest_point = ClosestPoint(Point=point, Cloud=cull_pattern)  # -> ClosestPoint, CPIndex, Distance
list_length = ListLength(List=closest_point.ClosestPoint)
cull_duplicates_2 = CullDuplicates(Points=closest_point.ClosestPoint, Tolerance=0.1, CullMode=3)  # -> Points, Indices, Valence
panel = Panel(cull_duplicates_2.Points)
division = Division(A=list_length, B=Slider(3, range=0..10))
loop_start = LoopStart(Repeat=division, Trigger=Button(), Data=cull_duplicates_2.Points)  # -> port, Counter, Data
list_item = ListItem(List=loop_start.Data, Index=Slider(1, range=0..1), Wrap=True)
point_2 = Point(Point(-2276, -2472, 0))
brep = Brep(<brep referenced from the Rhino model>)
point_3 = Point(list_item)
move_to_point = MoveToPoint(Geometry=brep, PointA=point_2, PointB=point_3)  # -> Moved, Vector, Transform
list_length_2 = ListLength(List=loop_start.Data)
number_slider_2 = Slider(90, range=0..100)
geometry_2 = Geometry(move_to_point.Moved)
smaller_than_2 = SmallerThan(FirstNumber=list_length_2, SecondNumber=Slider(2, range=0..10))  # -> SmallerThan, OrEqualTo
ghpython_script_2 = GhPythonScript(geometry=geometry_2, CenterList=cull_duplicates_2.Points, PointList=loop_start.Data)  # -> out, b, PointOut; inputs geometry: Brep, CenterList: list of Point3d, PointList: list of Point3d
# ---------- ghpython_script_2: Python ----------
__author__ = "mukul"
__version__ = "2021.04.06"

import time
import rhinoscriptsyntax as rs
import Rhino as rh

Switch = False
b=[]
PointOut=[]


for point in CenterList:
    zpt = rs.AddPoint(point.X,point.Y,(point.Z)+1)
    Zaxis=rs.VectorCreate(point,zpt)
    xpt = rs.AddPoint((point.X)+1,point.Y,point.Z)
    Xaxis=rs.VectorCreate(point,xpt)
    if Switch == False:
        for i in range(0,3):
            Object = geometry
            a=rs.RotateObject(Object,point,i*90,Zaxis,copy=True)
            for j in range(0,3):
                if Switch == False:
                    a=rs.RotateObject(Object,point,j*90,Xaxis,copy=True)
                    PointIn=[]
                    for p in PointList:
                        if rs.IsPointInSurface(a,p)==True:
                            PointIn.append(p)
                    if len(PointIn)==3:
                        PointOut = PointIn
                        b.append(a)
                        Switch = True
                    print(len(PointIn))
# ---------- end ghpython_script_2 ----------
object_bake = ObjectBake(
    BakeToggle=False,
    GeometryObjects=ghpython_script_2.b,
    Layer="GH_Bake",
    ObjectName="GH_Obj",
    ObjectColor=RGB(255, 255, 255),
    LayerColor=RGB(255, 255, 255))
geometry_3 = Geometry(ghpython_script_2.b)
point_4 = Point(ghpython_script_2.PointOut)
object_bake_2 = ObjectBake(
    BakeToggle=Toggle(True),
    GeometryObjects=geometry_3,
    Layer="GH_Bake",
    ObjectName="GH_Obj",
    ObjectColor=RGB(255, 255, 255),
    LayerColor=RGB(255, 255, 255))
closest_point_2 = ClosestPoint(Point=point_4, Cloud=loop_start.Data)  # -> ClosestPoint, CPIndex, Distance
cull_pattern_2 = CullPattern(List=loop_start.Data, CullPattern=[False, False, True, True])
cull_index = CullIndex(List=cull_pattern_2, Indices=closest_point_2.CPIndex, Wrap=True)  # -> flatten(List)
loop_end = LoopEnd(
    port=loop_start.port,
    Exit=smaller_than_2.SmallerThan,
    Data=cull_index,
    TimeOutVal=0,
    pausedState=False,
    state="Constant output")
panel_2 = Panel(loop_end)
