# Grasshopper definition Crv to wall.gh (Grasshopper 1.0.7)
# plug-ins: Pufferfish

xy_plane = XYPlane(Origin=Point(0, 0, 0))
xy_plane_2 = XYPlane(Origin=Point(0, 0, 0))
panel = Panel("walls")
curve = Curve([<curve referenced from the Rhino model> x6])
panel_2 = Panel("windows")
curve_2 = Curve([<curve referenced from the Rhino model> x5])
unit_z = UnitZ(Factor=Slider(3000, range=0..10000))
offset_curve = OffsetCurve(Curve=curve, Distance=Slider(150, range=0..1000), Plane=xy_plane, BothSides=True, Kinks=0, CapType=1)
unit_z_2 = UnitZ(Factor=Slider(1200, range=0..10000))
unit_z_3 = UnitZ(Factor=Slider(900, range=0..10000))
offset_curve_2 = OffsetCurve(Curve=curve_2, Distance=Slider(1000, range=0..1000), Plane=xy_plane_2, BothSides=True, Kinks=0, CapType=1)
boundary_surfaces = BoundarySurfaces(Edges=offset_curve)
extrude = Extrude(Base=boundary_surfaces, Direction=unit_z)  # -> flatten(Extrusion)
boundary_surfaces_2 = BoundarySurfaces(Edges=offset_curve_2)
extrude_2 = Extrude(Base=boundary_surfaces_2, Direction=unit_z_2)  # -> flatten(Extrusion)
solid_union = SolidUnion(Breps=extrude)
move = Move(Geometry=extrude_2, Motion=unit_z_3)  # -> Geometry, Transform
solid_difference = SolidDifference(BrepsA=solid_union, BrepsB=move.Geometry)
