# Grasshopper definition Crv-Srf_interferance.gh (Grasshopper 1.0.7)

number_slider = Slider(18, range=0..100)
srf = Surface(<surface referenced from the Rhino model>)
geo = Geometry([<curve referenced from the Rhino model> x2])
sdivide = DivideSurface(Surface=srf, UCount=number_slider, VCount=number_slider)  # -> Points, Normals, Parameters
pull = PullPoint(Point=sdivide.Points, Geometry=geo, ClosestOnly=True)  # -> ClosestPoint, Distance
smaller = SmallerThan(FirstNumber=pull.Distance, SecondNumber=Slider(747, range=0..1000))  # -> SmallerThan, OrEqualTo
cull = CullPattern(List=sdivide.Points, CullPattern=invert(smaller.SmallerThan))
cp = ClosestPoint(Point=sdivide.Points, Cloud=flatten(cull))  # -> ClosestPoint, CPIndex, Distance
cullpt = CullDuplicates(Points=cp.ClosestPoint, Tolerance=0.1, CullMode=3)  # -> Points, Indices, Valence
pline = PolyLine(Vertices=cullpt.Points, Closed=False)
divide = DivideCurve(Curve=pline, Count=Slider(5, range=0..1000), Kinks=False)  # -> Points, Tangents, Parameters
nurbs = NurbsCurve(Vertices=divide.Points, Degree=3, Periodic=False)  # -> Curve, Length, Domain
pull_2 = PullPoint(Point=sdivide.Points, Geometry=nurbs.Curve, ClosestOnly=True)  # -> ClosestPoint, Distance
remap = RemapNumbers(Value=pull_2.Distance, Source=divide.Tangents, Target=Domain(0, 1))  # -> Mapped, Clipped
cullpt_2 = CullDuplicates(Points=pull_2.ClosestPoint, Tolerance=0.1, CullMode=3)  # -> Points, Indices, Valence
Z = UnitZ(Factor=1)
multiplication = Multiplication(A=remap.Mapped, B=Slider(0.41, range=0..10))
amp = Amplitude(Vector=Z, Amplitude=multiplication)
move = Move(Geometry=cullpt_2.Points, Motion=amp)  # -> Geometry, Transform
addition = Addition(A=Slider(1, range=0..1), B=number_slider)
srfgrid = SurfaceFromPoints(Points=flatten(move.Geometry), UCount=addition, Interpolate=False)
