# Grasshopper definition Field driven fluids.gh (Grasshopper 1.0.7)
# plug-ins: Jellyfish

crv = Curve([<curve referenced from the Rhino model> x2])
divide = DivideCurve(Curve=crv, Count=Slider(9, range=0..10), Kinks=False)  # -> Points, Tangents, Parameters
crv_2 = Curve(<curve referenced from the Rhino model>)
crv_3 = Curve(<curve referenced from the Rhino model>)
number_slider = Slider(4, range=0..10)
crv_4 = Curve(<curve referenced from the Rhino model>)
number_slider_2 = Slider(8, range=0..10)
number_slider_3 = Slider(8, range=0..10)
pt = Point(<point referenced from the Rhino model>)
curvepoint = PointOnCurve(crv_2, parameter=0.5)
curvepoint_2 = PointOnCurve(crv_3, parameter=0.5)
curvepoint_3 = PointOnCurve(crv_4, parameter=0.5)
python = GhPythonScript(origin=pt, x=number_slider, y=number_slider, z=number_slider, size=Slider(114, range=0..200))  # -> out, pointGrid; inputs origin: Point3d, x: Int32, y: Int32, z: Int32
# ---------- python: Python ----------
__author__ = "mukul"
__version__ = "2021.06.27"

import rhinoscriptsyntax as rs
import Rhino.Geometry as rg

pointGrid = []

for i in range(0,x):
    len =i*size +origin.X
    for j in  range(0,y):
        wid = j*size + origin.Y
        for k in  range(0,z):
            ht =k*size + origin.Z
            point = rg.Point3d(len,wid,ht)
            pointGrid.Add(point)
# ---------- end python ----------
pl = PlaneNormal(Origin=curvepoint, ZAxis=crv_2)
pl_2 = PlaneNormal(Origin=curvepoint_2, ZAxis=crv_3)
pl_3 = PlaneNormal(Origin=curvepoint_3, ZAxis=crv_4)
pt_2 = Point(python.pointGrid)
pt_3 = Point(flatten(pt_2))
crv_5 = Curve(<curve referenced from the Rhino model>)
fspin = SpinForce(Plane=pl, Strength=Slider(10, range=0..10), Radius=Slider(97, range=0..100), Decay=Slider(1, range=-10..10))  # -> flatten(Field)
fspin_2 = SpinForce(Plane=pl_2, Strength=Slider(10, range=0..10), Radius=Slider(97, range=0..100), Decay=Slider(1, range=-10..10))  # -> flatten(Field)
fspin_3 = SpinForce(Plane=pl_3, Strength=Slider(5, range=0..10), Radius=Slider(100, range=0..100), Decay=Slider(1, range=-10..10))  # -> flatten(Field)
fvector = VectorForce(Line=crv_5)
mergef = MergeFields(Fields=[fspin_3, fspin_2, fvector, fspin])
fline = FieldLine(Field=mergef, Point=pt_3, Steps=Slider(483, range=0..1000), Accuracy=1, Method=3)  # -> flatten(Curve)
implicitcurve = ImplicitCurve(Curve=fline, Radius=Slider(30, range=0..100))  # -> flatten(ImplicitCurve)
implicitnarysmoothunion = ImplicitNarySmoothUnion(Functions=implicitcurve, Strength=Slider(5, range=0..50))
isosurface = IsoSurface(Function=implicitnarysmoothunion, Resolution=Slider(50, range=0..100), IsoValue=0, Parallel=True, ExpandBox=0)  # -> Mesh, CellSize
mesh = Mesh(isosurface.Mesh)
