# Grasshopper definition Solar optimization.gh (Grasshopper 1.0.7)

number_slider = Slider(0, range=0..100)
construct_point = ConstructPoint(XCoordinate=number_slider, YCoordinate=number_slider, ZCoordinate=number_slider)
circle_cnr = CircleCNR(Center=construct_point, Normal=Vector(0, 0, 1), Radius=Slider(60, range=0..100))
divide_curve = DivideCurve(Curve=circle_cnr, Count=Slider(9, range=0..10), Kinks=False)  # -> Points, Tangents, Parameters

# ----
# Select Hours to Analyze
number_slider_2 = Slider(12, range=0..23)
series = Series(Start=Slider(2, range=0..23), Step=1, Count=number_slider_2)
series_2 = Series(Start="1", Step=1, Count="12")
hoy = LBCalculateHOY(month=series_2, hour=graft(series))  # -> flatten(hoy), flatten(doy), flatten(date); plug-in component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

file_path = FilePath("C:\Users\mukul\Downloads\IND_DL_New.Delhi-Gandhi.Intl.AP.421810_TMYx.2004-2018\IND_DL_New.Delhi-Gandhi.Intl.AP.421810_TMYx.2004-2018.stat")
importstat = LBImportSTAT(stat_file=file_path)  # -> location, ashrae_zone, koppen_zone, clear_dir_norm_rad, clear_diff_horiz_rad, ann_heat_dday_996, ann_heat_dday_990, ann_cool_dday_004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; plug-in component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

# ----
# Donwload EPW
file_path_2 = FilePath("C:\Users\mukul\Downloads\IND_DL_New.Delhi-Gandhi.Intl.AP.421810_TMYx.2004-2018\IND_DL_New.Delhi-Gandhi.Intl.AP.421810_TMYx.2004-2018.epw")
importepw = LBImportEPW(epw_file=file_path_2)  # -> location, dry_bulb_temperature, dew_point_temperature, relative_humidity, wind_speed, wind_direction, direct_normal_rad, diffuse_horizontal_rad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; plug-in component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

vector_2pt = Vector2Pt(PointA=construct_point, PointB=divide_curve.Points, Unitize=False)  # -> graft(Vector), Length
explode_tree = ExplodeTree(Data=vector_2pt.Vector)  # -> Branch0, Branch1, Branch2, Branch3, Branch4, Branch5, Branch6, Branch7, Branch8
explode_tree_2 = ExplodeTree(Data=graft(divide_curve.Points))  # -> Branch0, Branch1, Branch2, Branch3, Branch4, Branch5, Branch6, Branch7, Branch8
explode_tree_3 = ExplodeTree()  # -> Branch0, Branch1, Branch2, Branch3, Branch4
number_slider_3 = Slider(3.1, range=0..5)
number_slider_4 = Slider(4.3, range=0..5)
number_slider_5 = Slider(4.6, range=0..5)
number_slider_6 = Slider(3.1, range=0..5)
number_slider_7 = Slider(4.9, range=0..5)
number_slider_8 = Slider(4.9, range=0..5)
number_slider_9 = Slider(4.2, range=0..5)
number_slider_10 = Slider(4.9, range=0..5)
number_slider_11 = Slider(4.9, range=0..5)
multiplication = Multiplication(A=explode_tree.Branch0, B=number_slider_3)
multiplication_2 = Multiplication(A=explode_tree.Branch1, B=number_slider_4)
multiplication_3 = Multiplication(A=explode_tree.Branch2, B=number_slider_5)
multiplication_4 = Multiplication(A=explode_tree.Branch3, B=number_slider_6)
multiplication_5 = Multiplication(A=explode_tree.Branch4, B=number_slider_8)
multiplication_6 = Multiplication(A=explode_tree.Branch5, B=number_slider_7)
multiplication_7 = Multiplication(A=explode_tree.Branch6, B=number_slider_9)
multiplication_8 = Multiplication(A=explode_tree.Branch7, B=number_slider_10)
multiplication_9 = Multiplication(A=explode_tree.Branch8, B=number_slider_11)

# ----
# Select Sun Vectors
panel = Panel("a < 16")
pt = Point(Point(0, 0, 0))
sunpath = LBSunPath(location=importepw.location, hoys=hoy.hoy, center_pt=pt, scale=1, data=importepw.dry_bulb_temperature, statement=panel)  # -> report, vectors, altitudes, azimuths, hoys, sun_pts, analemma, daily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; plug-in component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

move = Move(Geometry=explode_tree_2.Branch0, Motion=multiplication)  # -> Geometry, Transform
move_2 = Move(Geometry=explode_tree_2.Branch1, Motion=multiplication_2)  # -> Geometry, Transform
move_3 = Move(Geometry=explode_tree_2.Branch2, Motion=multiplication_3)  # -> Geometry, Transform
move_4 = Move(Geometry=explode_tree_2.Branch3, Motion=multiplication_4)  # -> Geometry, Transform
move_5 = Move(Geometry=explode_tree_2.Branch4, Motion=multiplication_5)  # -> Geometry, Transform
move_6 = Move(Geometry=explode_tree_2.Branch4, Motion=multiplication_5)  # -> Geometry, Transform
move_7 = Move(Geometry=explode_tree_2.Branch5, Motion=multiplication_6)  # -> Geometry, Transform
move_8 = Move(Geometry=explode_tree_2.Branch6, Motion=multiplication_7)  # -> Geometry, Transform
move_9 = Move(Geometry=explode_tree_2.Branch7, Motion=multiplication_8)  # -> Geometry, Transform
move_10 = Move(Geometry=explode_tree_2.Branch8, Motion=multiplication_9)  # -> Geometry, Transform
skymatrix = LBCumulativeSkyMatrix(
    location=importepw.location,
    direct_rad=importstat.clear_dir_norm_rad,
    diffuse_rad=importstat.clear_diff_horiz_rad,
    hoys=hoy.hoy)  # -> out, sky_mtx; plug-in component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
merge = Merge(
    Data1=move.Geometry,
    Data2=move_2.Geometry,
    Data3=move_3.Geometry,
    Data4=move_4.Geometry,
    Data5=move_5.Geometry,
    Data6=move_6.Geometry,
    Data7=move_7.Geometry,
    Data8=move_8.Geometry,
    Data9=move_9.Geometry,
    Data10=move_10.Geometry)  # -> flatten(Result)
polyline = PolyLine(Vertices=merge, Closed=True)
unit_z = UnitZ(Factor=Slider(422, range=0..500))
extrude = Extrude(Base=polyline, Direction=unit_z)
geometry = Geometry(extrude)
cap_holes = CapHoles(Brep=extrude)
incidentradiation = LBIncidentRadiation(
    sky_mtx=skymatrix.sky_mtx,
    geometry=flatten(geometry),
    grid_size=Slider(20, range=0..500),
    offset_dist=Slider(1, range=0..1),
    run=Toggle(True))  # -> out, points, results, total, mesh, legend, title, int_mtx; plug-in component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
panel_2 = Panel(incidentradiation.total)
area = Area(Geometry=polyline)  # -> Area, Centroid
division = Division(A=area.Area, B=panel_2)
galapagos = Galapagos(
    fitness=division,
    gene=[number_slider_4, number_slider_3, number_slider_5, number_slider_6, number_slider_8, number_slider_7, number_slider_9, number_slider_10, number_slider_11])
