# Grasshopper definition area_to_volume.gh (Grasshopper 1.0.7)
# plug-ins: LunchBox

file_path = FilePath("E:\Code\arearatio.csv")
read_file = ReadFile(File=file_path, PerLineParse=True)
read_csv = ReadCSV(CSVString=read_file, Delimiter=",")  # -> Headers, Values
flip_matrix = FlipMatrix(Data=read_csv.Values)
panel = Panel(read_csv.Values)
explode_tree = ExplodeTree(Data=panel)  # -> Branch0, Branch1, Branch2, Branch3, Branch4
functions = Panel(explode_tree.Branch0)
area_of_each_space = Panel(explode_tree.Branch1)
length_width_ratio = Panel(explode_tree.Branch2)
number_of_spaces = Panel(explode_tree.Branch3)
total_area = Panel(explode_tree.Branch4)
c_script = CSharpScript()  # -> out, boundary; inputs InputFunction: String, InputArea: Double, InputRatio: Double
# ---------- c_script: C# usings ----------
using math;
# ---------- c_script: C# ----------
    float width = math.sqrt(InputArea) * InputRatio;
    float length = InputArea / width;
# ---------- c_script: C# additional code ----------
  /// <summary>
  /// This method will be called once every solution, before any calls to RunScript.
  /// </summary>
  public override void BeforeRunScript()
  { }
  /// <summary>
  /// This method will be called once every solution, after any calls to RunScript.
  /// </summary>
  public override void AfterRunScript()
  { }
# ---------- end c_script ----------
ghpython_script = GhPythonScript(InputFunction=functions, InputArea=area_of_each_space, InputRatio=length_width_ratio)  # -> out, boundary
# ---------- ghpython_script: Python ----------
__author__ = "mukul"
__version__ = "2020.12.21"

import rhinoscriptsyntax as rs
import math
from System.Drawing import *
from Rhino import *
from Rhino.DocObjects import *
from Rhino.Geometry import *
from Rhino.Input import *
from Rhino.Commands import *
from Rhino.UI.Dialogs import ShowColorDialog
from scriptcontext import doc

function = InputFunction 
area = float(InputArea)
ratio = float(InputRatio)

width = math.sqrt(area)*ratio
length = area/width

plane = rs.WorldXYPlane()
boundary = rs.AddRectangle(plane,width,length)
# ---------- end ghpython_script ----------
ghpython_script_2 = GhPythonScript(x=functions)  # -> out, a; inputs x: tree
# ---------- ghpython_script_2: Python ----------
__author__ = "mukul"
__version__ = "2021.04.01"

import rhinoscriptsyntax as rs

a = []

for i in range(x.BranchCount):
    branchList = x.Branch(i)
    branchPath = x.Path(i)
    
    for j in range(branchList.Count):
        s = str(branchPath) + "[" + str(j) + "] "
        s += type(branchList[j]).__name__ + ": "
        s += str(branchList[j])
        
        a.append(s)
# ---------- end ghpython_script_2 ----------
ghpython_script_3 = GhPythonScript(InputFunction=functions, InputArea=area_of_each_space, InputRatio=length_width_ratio, graphWidth=Slider(5, range=0..10))  # -> out, boundary
# ---------- ghpython_script_3: Python ----------
__author__ = "mukul"
__version__ = "2020.12.21"

import rhinoscriptsyntax as rs
import math
from System.Drawing import *
from Rhino import *
from Rhino.DocObjects import *
from Rhino.Geometry import *
from Rhino.Input import *
from Rhino.Commands import *
from Rhino.UI.Dialogs import ShowColorDialog
from scriptcontext import doc
import ghpythonlib.treehelpers as th


function = InputFunction 
area = float(InputArea)


width = graphWidth
length = area/width

plane = rs.WorldXYPlane()
boundary = rs.AddRectangle(plane,width,length)
# ---------- end ghpython_script_3 ----------
panel_2 = Panel(ghpython_script_2.a)
