# Grasshopper definition Voxel_Aggregation.gh (Grasshopper 1.0.7)
# plug-ins: Voxelizer, Anemone

# ---- group: Input Module Mesh
mesh = Mesh(<mesh referenced from the Rhino model>)

# ----
bounding_mesh = Mesh(<mesh referenced from the Rhino model>)

# ---- group: Point of transformation
origin = Point(<point referenced from the Rhino model>)

# ---- group: Generation Curve
pointcloud_selection_curve = Curve(<curve referenced from the Rhino model>)

# ---- group: no. of points inside geometry
panel = Panel("3")

# ---- group: 1. Point Cloud
cloud_selection_radius = Slider(2, range=0..10)
voxel_size = Slider(10, range=0..10)
voxelizer = Voxelizer(Mesh=bounding_mesh, Size=voxel_size)  # -> Voxels, Points
multiplication = Multiplication(A=voxel_size, B=cloud_selection_radius)
curve_closest_point = CurveClosestPoint(Point=voxelizer.Points, Curve=pointcloud_selection_curve)  # -> Point, Parameter, Distance
larger_than = LargerThan(FirstNumber=curve_closest_point.Distance, SecondNumber=multiplication)  # -> LargerThan, OrEqualTo
cull_pattern = CullPattern(List=voxelizer.Points, CullPattern=invert(larger_than.LargerThan))
sort_points = SortPoints(Points=cull_pattern)  # -> Points, Indices

# ---- group: 2. Module
panel_2 = Panel("""1
3""")
plane = Plane(origin)
series = Series(Start=0, Step=1, Count="4")
deconstruct_plane = DeconstructPlane(Plane=plane)  # -> Origin, XAxis, YAxis, ZAxis
multiplication_2 = Multiplication(A="0.5*pi", B=series)
multiplication_3 = Multiplication(A="0.5*pi", B=panel_2)
rotate_3d = Rotate3D(Geometry=mesh, Angle=multiplication_3, Center=deconstruct_plane.Origin, Axis=deconstruct_plane.YAxis)  # -> graft(Geometry), Transform
rotate_3d_2 = Rotate3D(Geometry=mesh, Angle=multiplication_2, Center=deconstruct_plane.Origin, Axis=deconstruct_plane.XAxis)  # -> graft(Geometry), Transform
merge = Merge(Data1=rotate_3d.Geometry, Data2=rotate_3d_2.Geometry)
rotate_3d_3 = Rotate3D(Geometry=merge, Angle=multiplication_2, Center=deconstruct_plane.Origin, Axis=deconstruct_plane.ZAxis)  # -> flatten(Geometry), Transform

# ----
list_length = ListLength(List=sort_points.Points)
safety_offset = Slider(50, range=0..100)
division = Division(A=list_length, B=panel)
addition = Addition(A=division, B=safety_offset)
loop_start = LoopStart(Repeat=addition, Trigger=Button(), Data=sort_points.Points)  # -> port, Counter, Data
point = Point(loop_start.Data)

# ---- group: 3.1 select random point
list_length_2 = ListLength(List=point)
random = Random(Range=list_length_2, Number=1, Seed=loop_start.Counter)
list_item = ListItem(List=point, Index=random, Wrap=True)

# ---- group: 3.2 move geometry to selected random point
vector_2pt = Vector2Pt(PointA=origin, PointB=list_item, Unitize=False)  # -> Vector, Length
move = Move(Geometry=rotate_3d_3.Geometry, Motion=vector_2pt.Vector)  # -> Geometry, Transform

# ---- group: 3.3 Check which orientations can be placed
mesh_2 = Mesh(graft(move.Geometry))
mesh_inclusion = MeshInclusion(Mesh=mesh_2, Point=point, Strict=False)
sort_list = SortList(Keys=mesh_inclusion)  # -> Keys, ValuesValuesA
mass_addition = MassAddition(Input=sort_list.Keys)  # -> Result, PartialResults
equality = Equality(FirstNumber=mass_addition.Result, SecondNumber=panel)  # -> flatten(Equality), Inequality

# ---- group: 3.4 select a geometry from possible orientations
sift_pattern = SiftPattern(List=flatten(mesh_2), SiftPattern=equality.Equality)  # -> Output0, Output1
clean_tree = CleanTree(RemoveNulls=True, RemoveInvalid=True, RemoveEmpty=False, Tree=sift_pattern.Output1)
list_length_3 = ListLength(List=clean_tree)
random_2 = Random(Range=list_length_3, Number=1, Seed=2)
list_item_2 = ListItem(List=clean_tree, Index=random_2, Wrap=True)

# ---- group: 3.5 cull ponits which have the geometry placed.
sift_pattern_2 = SiftPattern(List=simplify(mesh_inclusion), SiftPattern=graft(equality.Equality))  # -> Output0, Output1
clean_tree_2 = CleanTree(RemoveNulls=True, RemoveInvalid=True, RemoveEmpty=True, Tree=sift_pattern_2.Output1)
tree_statistics = TreeStatistics(Tree=clean_tree_2)  # -> Paths, Length, Count
list_item_3 = ListItem(List=tree_statistics.Paths, Index=random_2, Wrap=True)
tree_branch = TreeBranch(Tree=clean_tree_2, Path=list_item_3, MaintainPaths=True)
cull_pattern_2 = CullPattern(List=point, CullPattern=invert(tree_branch))  # -> flatten(List)

# ----
null = NullItem(Item=clean_tree_2)  # -> NullFlags, InvalidFlags, Description
gate = StreamGate(Stream=point, Gate=null.NullFlags)  # -> Target0, Target1
data_recorder = DataRecorder(list_item_2, DataLimit=-10, RecordData=True)
point_2 = Point([cull_pattern_2, gate.Target1])
equality_2 = Equality(FirstNumber=loop_start.Counter, SecondNumber=addition)  # -> Equality, Inequality
loop_end = LoopEnd(port=loop_start.port, Exit=Toggle(False), Data=point_2, TimeOutVal=0, pausedState=False, state="Constant output")
preview = CustomPreview(Geometry=data_recorder, Material=ColourSwatch(SwatchColor=RGB(255, 255, 255)))
mesh_3 = Mesh(data_recorder)
stream_gate = StreamGate(Stream=loop_end, Gate=equality_2.Equality)  # -> Target0, Target1
point_3 = Point(stream_gate.Target1)
