# Grasshopper definition recursiveSubdivision01.gh (Grasshopper 1.0.7)
# plug-ins: Heteroptera

center = Center(Geometry=<missing>, forall=False, referenceAll=0)  # -> graft(Center), Dimension
ghpython_script = GhPythonScript(
    size=Slider(100, range=0..100),
    step=Slider(6, range=0..10),
    vertexIndex=Slider(0, range=0..3),
    ratio=Slider(0.28, range=0..0.5),
    bool=Toggle(False))  # -> Out, draw; inputs size: Int32, step: Int32, vertexIndex: Int32, bool: Boolean
# ---------- ghpython_script: Python ----------
__author__ = "mukul"
__version__ = "2021.06.05"

import rhinoscriptsyntax as rs
import Rhino.Geometry as rg
import System.Collections as s


def vector2pt(point01,point02):
    outPt = rg.Point3d(point01.X-point02.X,point01.Y-point02.Y,point01.Z-point02.Z)
    return rg.Vector3d(outPt)

def Subdivide(poly,step):
    tempPoly = poly
    poly = []
    if(step == 0):
        return tempPoly
    else:
        for pts in tempPoly:
            pt0 = pts[0]
            pt2 = pts[1]
            pt4 = pts[2]
            pt6 = pts[3]
            
            pt1 = rg.Point3d.Multiply(rg.Point3d.Add(pt0,pt2),0.5)
            pt3 = rg.Point3d.Multiply(rg.Point3d.Add(pt2,pt4),0.5)
            pt5 = rg.Point3d.Multiply(rg.Point3d.Add(pt4,pt6),0.5)
            pt7 = rg.Point3d.Multiply(rg.Point3d.Add(pt6,pt0),0.5)
            center = pts.CenterPoint ()
            vector = rg.Vector3d.Multiply(vector2pt(center,pts[vertexIndex]),ratio)
            pt8= rg.Point3d.Add(center,vector)
            if (bool == True):
                subDPoly1 = rg.Polyline([pt0,pt1,pt8,pt7,pt0])
                subDPoly4 = rg.Polyline([pt7,pt8,pt5,pt6,pt7])
                subDPoly2 = rg.Polyline([pt1,pt2,pt3,pt8,pt1])
                subDPoly3 = rg.Polyline([pt8,pt3,pt4,pt5,pt8])
            else:
                subDPoly1 = rg.Polyline([pt0,pt1,pt8,pt7,pt0])
                subDPoly2 = rg.Polyline([pt2,pt1,pt8,pt3,pt2])
                subDPoly3 = rg.Polyline([pt4,pt5,pt8,pt3,pt4])
                subDPoly4 = rg.Polyline([pt6,pt5,pt8,pt7,pt6])
                
            poly.extend([subDPoly1,subDPoly2,subDPoly3,subDPoly4])
        step = step-1
        
    return Subdivide(poly,step)


draw = []
plane = rg.Plane.WorldXY
Square = rg.Rectangle3d(plane,size,size)
polysq = Square.ToPolyline()
polyList =[]
polyList.append(polysq)
draw = Subdivide(polyList,step)
# ---------- end ghpython_script ----------
curve = Curve(ghpython_script.draw)
